# Grasshopper definition final project starter.gh (Grasshopper 1.0.8)

leg_width = Slider(5, range=0..10)
xy_plane = XYPlane(Origin=Point(0, 0, 0))
height_x = Multiplication(A=leg_width, B="5")
rectangle = Rectangle(Plane=xy_plane, XSize=leg_width, YSize=leg_width, Radius=0)  # -> Rectangle, Length
unit_z = UnitZ(Factor=height_x)
extrude = Extrude(Base=rectangle.Rectangle, Direction=unit_z)
number_slider = Slider(20, range=0..100)
cap_holes = CapHoles(Brep=extrude)
unit_x = UnitX(Factor=number_slider)
unit_y = UnitY(Factor=number_slider)
geometry_leg_1 = Geometry(cap_holes)
geometry = Geometry(cap_holes)
geometry_2 = Geometry(cap_holes)
move = Move(Geometry=geometry_2, Motion=unit_x)  # -> Geometry, Transform
move_2 = Move(Geometry=geometry, Motion=unit_y)  # -> Geometry, Transform
geometry_leg_2 = Geometry(move_2.Geometry)
unit_y_2 = UnitY(Factor=number_slider)
geometry_leg_4 = Geometry(move.Geometry)
geometry_3 = Geometry(move.Geometry)
move_3 = Move(Geometry=geometry_3, Motion=unit_y_2)  # -> Geometry, Transform
unit_z_2 = UnitZ(Factor=height_x)
width = Addition(SpacingBetweenLegs=number_slider, LegWidth=leg_width)
geometry_leg_3 = Geometry(move_3.Geometry)
xy_plane_2 = XYPlane(Origin=unit_z_2)
unit_z_3 = UnitZ(Factor=leg_width)
rectangle_2 = Rectangle(Plane=xy_plane_2, XSize=width, YSize=width, Radius=0)  # -> Rectangle, Length
addition = Addition(LegHeight=height_x, HeightOfSeat=leg_width)
extrude_2 = Extrude(Base=rectangle_2.Rectangle, Direction=unit_z_3)
unit_z_4 = UnitZ(Factor=addition)
cap_holes_2 = CapHoles(Brep=extrude_2)
rectangle_3 = Rectangle(Plane=unit_z_4, XSize=leg_width, YSize=width, Radius=0)  # -> Rectangle, Length
unit_z_5 = UnitZ(Factor=Slider(25, range=0..100))
top = Geometry(cap_holes_2)
extrude_3 = Extrude(Base=rectangle_3.Rectangle, Direction=unit_z_5)
cap_holes_3 = CapHoles(Brep=extrude_3)
