# Grasshopper definition final project test.gh (Grasshopper 1.0.8)
# plug-ins: MeshEdit Components, Pancake, Nautilus

mega_spun_chair_mesh = Mesh(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)
# Import Object: 1. Import object into Rhino
# 2. Type in "Mesh" to the command line
# 3. Right click "Mesh" in Grasshopper and then click "Set one mesh"
# 4. Click on the mesh of the object in Rhino
# 5. Internalize Data
spun_chair_mesh = Mesh(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)
giant_benchy = Mesh(<mesh referenced from the Rhino model>)
mesh = Mesh(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)
# Bounding Box + PopBox: Creates a bounding box around the object and then fills the bounding box with points
bbox = BoundingBox(Content=mesh, Plane=PlaneXY(0, 0, 0))  # -> Box, Box_2
popbox_with_points = PopulateABox(Box=bbox.Box, NumberOfPoints="100000")
# Mesh Include / Dispatch: Determines weather or not the points are in the mesh or not in the mesh
minc = MeshInclusion(Mesh=mesh, Point=popbox_with_points, Strict=False)
dispatch = Dispatch(List=popbox_with_points, DispatchPattern=minc)  # -> InMesh, NOTInMesh
of_groups = Slider(12, range=1..20)
points_within_mesh = Point(dispatch.InMesh)
k_means_clustering = CSharpScript(points=flatten(points_within_mesh), groupsNumber=of_groups, precision=Slider(16, range=1..50), seed="0.2")  # -> out, G, Id; inputs points: list of Point3d, groupsNumber: Int32, precision: Double, seed: Int32
# ---------- k_means_clustering: C# ----------
using System;
using System.Collections;
using System.Collections.Generic;

using Rhino;
using Rhino.Geometry;

using Grasshopper;
using Grasshopper.Kernel;
using Grasshopper.Kernel.Data;
using Grasshopper.Kernel.Types;

/// <summary>
/// This class will be instantiated on demand by the Script component.
/// </summary>
public class Script_Instance : GH_ScriptInstance
{
  /// <summary>Print a String to the [Out] Parameter of the Script component.</summary>
  /// <param name="text">String to print.</param>
  private void Print(string text) { /* Implementation hidden. */ }
  /// <summary>Print a formatted String to the [Out] Parameter of the Script component.</summary>
  /// <param name="format">String format.</param>
  /// <param name="args">Formatting parameters.</param>
  private void Print(string format, params object[] args) { /* Implementation hidden. */ }
  /// <summary>Print useful information about an object instance to the [Out] Parameter of the Script component. </summary>
  /// <param name="obj">Object instance to parse.</param>
  private void Reflect(object obj) { /* Implementation hidden. */ }
  /// <summary>Print the signatures of all the overloads of a specific method to the [Out] Parameter of the Script component. </summary>
  /// <param name="obj">Object instance to parse.</param>
  private void Reflect(object obj, string method_name) { /* Implementation hidden. */ }

  /// <summary>Gets the current Rhino document.</summary>
  private readonly RhinoDoc RhinoDocument;
  /// <summary>Gets the Grasshopper document that owns this script.</summary>
  private readonly GH_Document GrasshopperDocument;
  /// <summary>Gets the Grasshopper script component that owns this script.</summary>
  private readonly IGH_Component Component;
  /// <summary>
  /// Gets the current iteration count. The first call to RunScript() is associated with Iteration==0.
  /// Any subsequent call within the same solution will increment the Iteration count.
  /// </summary>
  private readonly int Iteration;

  /// <summary>
  /// This procedure contains the user code. Input parameters are provided as regular arguments,
  /// Output parameters as ref arguments. You don't have to assign output parameters,
  /// they will have a default value.
  /// </summary>
  private void RunScript(
		List<Point3d> points,
		int groupsNumber,
		double precision,
		int seed,
		ref object G,
		ref object Id)
  {
    //Code by Dieter Toews
    //https://www.grasshopper3d.com/forum/topics/kmeans-1
    //Rewritten in January 2019 by Laurent Delrieu

    //***************** Initialize K-Means Algorithm ****************************
    Print("--------Initializing " + groupsNumber + " groupings-------");
    Component.Message = "K-Means Clustering v2";

    List<List<int>> groupings = new List<List<int>>();
    List<Point3d> oldCentroids = new  List<Point3d> ();
    List<Point3d> newCentroids = new  List<Point3d> ();
    for (int i = 0; i < groupsNumber; i++)
    {
      groupings.Add(new List<int>());
      newCentroids.Add(Point3d.Origin);
      oldCentroids.Add(Point3d.Origin);
      Print("creating grouping " + i);
    }
    //randomly assign points from the input list (intialze the k-mean groups)
    Print("--------Initializing group assignments (random)-------");
    Random r = new Random(seed);
    DataTree<Point3d> groupingsTree = new DataTree<Point3d>();
    for (int j = 0 ; j < points.Count; j++)
    {
      int groupNum = RandomNumber(r, groupsNumber - 1, 0);
      groupings[groupNum].Add(j);
      Print("Adding index value " + groupings[groupNum][groupings[groupNum].Count - 1] + " to group " + groupNum + ".");
    }
    //***************** Do K-Means Algorithm ************************************
    Print("--------Entering main k-means loop--------");
    bool isStillMoving = true;
    //Number of while counting
    int k = 0;
    double minDist, dist;
    Point3d XYZ = Point3d.Origin;
    Point3d pt = Point3d.Origin;

    while ( isStillMoving)
    {
      isStillMoving = false;
      //find new centroids
      Print(".....finding new centroids");
      for (int i = 0; i < groupsNumber; i++)
      {
        oldCentroids[i] = newCentroids[i];
        for (int j = 0; j < groupings[i].Count; j++)
        {
          XYZ = XYZ + points[groupings[i][j]];
        }
        XYZ = XYZ / ((double) groupings[i].Count + 1);

        Point3d newCentroid = XYZ;
        newCentroids[i] = newCentroid;
        Print("New centroid for group " + i + " is " + newCentroids[i].ToString());
        groupings[i].Clear();
        dist = newCentroid.DistanceTo(oldCentroids[i]);

        if (dist > precision)
        {
          Print("need to do more work");
          isStillMoving = true;
        }
      }
      //create new groupings
      Print(".....creating new groupings");
      for (int j = 0; j < points.Count; j++)
      {
        pt = points[j];
        minDist = pt.DistanceTo(newCentroids[0]);
        int groupNum = 0;
        for (int i = 0; i < groupsNumber; i++)
        {
          dist = pt.DistanceTo(newCentroids[i]);
          if( minDist >= dist )
          {
            groupNum = i;
            minDist = dist;
          }
        }
        groupings[groupNum].Add(j);
        if ( isStillMoving == false)
        {
          groupingsTree.Add(pt, new GH_Path(groupNum));
        }
      }
      if (isStillMoving == false)
      {
        Print("***************all groups setled exiting loop********************");
        Print("***************total loop count is " + k + "************************");
      }
      //a hard limit on the number of loops to execute....
      if(k > 1000)
      {
        isStillMoving = false;
      }
      k += 1;
    }//End while
    G = groupingsTree;

    //DataTree<int> groupsIndex = new DataTree<int>();
    int[] groupsIndex = new int[points.Count];
    for (int i = 0; i < groupings.Count; i++)
    {
      for (int j = 0; j < groupings[i].Count; j++)
      {
        groupsIndex[groupings[i][j]] = i;
      }

    }


    Id = groupsIndex;
  }

  // <Custom additional code> 
  public int RandomNumber(Random r, int MaxNumber, int MinNumber)
  {
    //if passed incorrect arguments, swap them
    //can also throw exception or return 0
    if (MinNumber > MaxNumber)
    {
      int t = MinNumber;
      MinNumber = MaxNumber;
      MaxNumber = t;
    }
    return r.Next(MinNumber, MaxNumber);
  }
  // </Custom additional code> 
}
# ---------- end k_means_clustering ----------
convex_hull = _3DConvexHull(Objects=k_means_clustering.G, SplitPoints=False, Tolerance=0.1)
volume = MeshVolume(Mesh=convex_hull)  # -> Volume, Centroid
voronoi³ = Voronoi3D(Points=flatten(volume.Centroid), Box=bbox.Box)  # -> Cells, Boundary
debrep = DeconstructBrep(Brep=voronoi³.Cells)  # -> flatten(Faces), Edges, Vertices
area = Area(Geometry=debrep.Faces)  # -> Area, Centroid
lng = ListLength(List=area.Centroid)
series = Series(Start=0, Step=1, Count=lng)
cullpt = CullDuplicates(Points=area.Centroid, Tolerance="1", CullMode=2)  # -> Points, Indices, Valence
int = Integer(series)
symmetric_difference = SetDifferenceS(SetA=int, SetB=cullpt.Indices)
cutting_planes = ListItem(List=debrep.Faces, Index=symmetric_difference, Wrap=True)
area_2 = Area(Geometry=cutting_planes)  # -> Area, Centroid
cullpt_2 = CullDuplicates(Points=area_2.Centroid, Tolerance="1", CullMode=1)  # -> Points, Indices, Valence
item = ListItem(List=cutting_planes, Index=cullpt_2.Indices, Wrap=True)
mesh_2 = Mesh(item)
mint = MeshIntersection(MeshesA=mesh, MeshesB=graft(voronoi³.Cells))
cmwm = CutMeshWithMeshes(Mesh=graft(mesh_2), CuttersOriginalObj=mesh, Tolerance="0.5", Seed=444, Color_Meshes=True)  # -> simplify(graft(Meshes))
mesh_3 = Mesh(flatten(cmwm))
explode = MeshExplode(Mesh=mesh_3, Interpolate=False)
facen = FaceNormals(Mesh=explode)  # -> Centers, Normals
trim = TrimTree(Tree=facen.Centers, Depth=1)
item_2 = ListItem(List=trim, Index=0, Wrap=True)
minc_2 = MeshInclusion(Mesh=mesh, Point=item_2, Strict=False)  # -> flatten(Inside)
dispatch_2 = Dispatch(List=mesh_3, DispatchPattern=simplify(minc_2))  # -> ListA, ListB
mesh_4 = Mesh(dispatch_2.ListA)
length_of_dowels_cm = Slider(6, range=1..10)
area_3 = MeshArea(Mesh=mesh_4)  # -> Area, Centroid
meshcp = MeshClosestPoint(Point=area_3.Centroid, Mesh=mesh_4)  # -> Point, Index, Parameter
meval = MeshEval(Mesh=mesh_4, Parameter=meshcp.Parameter)  # -> Point, Normal, Colour
division = Division(A=length_of_dowels_cm, B="-2")
multiplication = Multiplication(A=meval.Normal, B=division)
distance_between_each_dowel_cm = Slider(20, range=1..20)
radius_of_dowels_leave_at_1 = Slider(1, range=1..4)
move = Move(Geometry=meval.Point, Motion=multiplication)  # -> Geometry, Transform
pl = PlaneNormal(Origin=move.Geometry, ZAxis=meval.Normal)
deplane = DeconstructPlane(Plane=pl)  # -> Origin, XAxis, YAxis, ZAxis
neg = Negative(Value=distance_between_each_dowel_cm)
multiplication_2 = Multiplication(A=deplane.XAxis, B=distance_between_each_dowel_cm)
move_2 = Move(Geometry=deplane.Origin, Motion=multiplication_2)  # -> Geometry, Transform
multiplication_3 = Multiplication(A=deplane.XAxis, B=neg)
create_plane = PlaneNormal(PlaneOrigin=move_2.Geometry, ZAxis=meval.Normal)
move_3 = Move(Geometry=deplane.Origin, Motion=multiplication_3)  # -> Geometry, Transform
pl_2 = PlaneNormal(Origin=move_3.Geometry, ZAxis=meval.Normal)
cyl = Cylinder(Base=create_plane, Radius=radius_of_dowels_leave_at_1, Length=length_of_dowels_cm)
cyl_2 = Cylinder(Base=pl_2, Radius=radius_of_dowels_leave_at_1, Length=length_of_dowels_cm)
cap = CapHoles(Brep=cyl)
cap_2 = CapHoles(Brep=cyl_2)
mjoin = MeshJoin(Meshes=flatten([cap, cap_2]))
mdif = MeshDifference(MeshesA=mint, MeshesB=mjoin)
mesh_5 = Mesh([mdif, cap, cap_2])
bbox_2 = BoundingBox(Content=flatten(mesh_5), Plane=PlaneXY(0, 0, 0), UnionBox=True)  # -> Box, Box_2
stable = StablePositions(Objects=mesh_5, Tolerance=0.01)  # -> ListOfMeshes, Number, Transform
factor_to_explode_by = Slider(1, range=1..40)
bbox_for_each_obj = BoundingBox(Content=mesh_5, Plane=PlaneXY(0, 0, 0))  # -> Box, Box_2
boxprop = BoxProperties(Box=bbox_for_each_obj.Box)  # -> CentersOfEachBox, Diagonal, Area, Volume, Degeneracy
find_center_of_obj = BoxProperties(Box=bbox_2.Box)  # -> Center, Diagonal, Area, Volume, Degeneracy
item_3 = ListItem(List=stable.Transform, Index=0, Wrap=True)
transform_mesh_to_object = Transform(Geometry=stable.ListOfMeshes, Transform=item_3)
explode_2 = Scale(Geometries=boxprop.CentersOfEachBox, Centerpoint=find_center_of_obj.Center, Factor=factor_to_explode_by)  # -> Geometry, Transform
pack_geometries_on_grid = PackGeometriesOnGrid(Geometries=simplify(transform_mesh_to_object), Ratio=1, Offset=0, Centered=True)  # -> Geometries, Rectangles, Transforms, NumberOfColumns, NumberOfRows
vec2pt = Vector2Pt(PointA=boxprop.CentersOfEachBox, PointB=explode_2.Geometry, Unitize=False)  # -> Vector, Length
export_credit_export_c_code_is_adapted_f = Panel("https://github.com/jhorikawa/GrasshopperProgrammingTutorials/tree/6e5b830b481bc0fbf5390d6b5504f5df180d1433/0015%20Export%20Geometry%20with%20Grasshopper%20C%23")  # "Export Credit (Export C# Code is adapted from this GitHub)"
move_4 = Move(Geometry=mesh_5, Motion=vec2pt.Vector)  # -> simplify(Geometry), Transform
click_to_export = TrueOnlyButton(LastSaveLocalization="neutral,N")
volume_2 = MeshVolume(Mesh=move_4.Geometry)  # -> flatten(Volume), Centroid
overwrite = BooleanToggle(True)
sort = SortList(Keys=volume_2.Volume)  # -> Keys, ValuesA
bnd = Bounds(Numbers=volume_2.Volume)
export = CSharpScript(
    geometries=pack_geometries_on_grid.Geometries,
    path="C:\Users\helen\Downloads",
    filename="exp_small_test",
    filetype="3mf",
    export=click_to_export,
    overwrite=overwrite)  # -> outResult, success; inputs geometries: tree of GeometryBase, path: String, filename: String, filetype: String, export: Boolean, overwrite: Boolean
# ---------- export: C# ----------
using System;
using System.Collections.Generic;
using System.IO;
using Grasshopper;
using Grasshopper.Kernel.Data;
using Rhino;
using Rhino.Geometry;

public class Script_Instance : GH_ScriptInstance
{
    private void RunScript(
		DataTree<GeometryBase> geometries,
		string path,
		string filename,
		string filetype,
		bool export,
		bool overwrite,
		ref object outResult,
		ref object success)
    {
        // Default success state
        bool ok = false;

        if (!export)
        {
            outResult = "Export disabled";
            success = false;
            return;
        }

        // Build full path: path + filename + extension
        string fullPath = Path.Combine(path, filename + "." + filetype);

        // Check if file exists
        if (File.Exists(fullPath) && !overwrite)
        {
            outResult = "File already exists, overwrite disabled";
            success = false;
            return;
        }

        // Add geometry to Rhino
        List<Guid> guids = new List<Guid>();

        for (int i = 0; i < geometries.BranchCount; i++)
        {
            for (int n = 0; n < geometries.Branches[i].Count; n++)
            {
                var geom = geometries.Branches[i][n];
                Guid g = RhinoDoc.ActiveDoc.Objects.Add(geom);
                guids.Add(g);
            }
        }

        // Select added objects
        RhinoDoc.ActiveDoc.Objects.Select(guids);

        // Export command
        string cmd = "-_Export \"" + fullPath + "\" _Enter";

        // Run Rhino export
        ok = Rhino.RhinoApp.RunScript(cmd, false);

        // Set output messages
        outResult = ok ? "Exported to: " + fullPath : "Export failed";
        success = ok;
    }
}
# ---------- end export ----------
panel = Panel(export.success)
export_result = Panel(export.outResult)
